test file "AutopilotTestFile"

suite "Basic Design Test Cases"

  case "Requirement 1.3 Test" [simulation]
    model RollAutopilotMdlRef, harness RollReference_Requirement1_3 (for RollAutopilotMdlRef/Roll Reference)
    custom criteria (off):
      % Return value: customCriteria
      % set customCriteria.out to true for pass and false for fail
      % set customCriteria.logs (cell array) for log messages
      % set customCriteria.errors (cell array) for error messages

      customCriteria.out = true;
    iteration script:
      % Test iterations initialize before any model callbacks and test callbacks

      %% Iterate across Parameter Sets and Signal Editor Scenarios / Builder Groups.

      % Determine the number of possible iterations
      numSteps = min([length(sltest_signalEditorScenarios), length(sltest_parameterSets)]);

      % Create each iteration
      for k = 1 : numSteps
          % Set up a new iteration object
          testItr = sltestiteration();

          % Set iteration settings
          setTestParam(testItr, 'SignalBuilderGroup', sltest_signalEditorScenarios{k});
          setTestParam(testItr, 'ParameterSet', sltest_parameterSets{k});

          % Register the iteration to run in this test case
          addIteration(sltest_testCase, testItr); % You can pass in an optional iteration name
      end

  case "Roll < 6 deg" [simulation]
    model RollAutopilotMdlRef, mode Normal

  case "Small Angle (<6°)" [simulation]
    model RollAutopilotMdlRef, mode Normal

  case "Small Angle" [simulation]
    mode Normal

  case "Auto_RollSmall" [simulation]
    mode Normal