% Requirement links of AutopilotTestFile.mldatx (R2024b)

item 1 verifies RollReference.slreqx#3: 1.3.1.1 phiref = 0 if phi < 6
item 1 verifies RollReference.slreqx#4: 1.3.1.2 phiref = 30 if phi > 30
item 1 verifies RollReference.slreqx#5: 1.3.1.3 phiref = tk if tk >= 3
item 2 verifies RollReference.slreqx#3: 1.3.1.1 phiref = 0 if phi < 6
item 2 verifies RollReference.slreqx#4: 1.3.1.2 phiref = 30 if phi > 30
item 2 verifies RollReference.slreqx#5: 1.3.1.3 phiref = tk if tk >= 3